# Grasshopper definition test.gh (Grasshopper 0.9.76)
# plug-ins: MeshEdit Components, Circulation

pt = Point(Point(7.757369282, 9.427361609, 0))
geo = Geometry(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)
geo_2 = Geometry(<curve referenced from the Rhino model>)
pt_2 = Point(Point(45.50310417, 44.32324773, 0))
node = Node(Position=pt, Name="start", Floor="floor1")
node_2 = Node(Position=pt_2, Name="end", Floor="floor1")
floor = Floor(Boundary=geo, Name="floor1")
agent = Agent(Name="agent1", Origin="start", Destination="end")
barrier = Barrier(Boundary=geo_2, Floor="floor1")

env = Environment(Entities=[floor, barrier, node, node_2, agent], Resolution=Slider(3, range=0..10), Run=Toggle(True))

apaths = AgentPaths(Environment=env)  # -> Mesh, Indexes
facen = FaceNormals(Mesh=apaths.Mesh)  # -> Centers, Normals
item = ListItem(List=facen.Centers, Index=apaths.Indexes, Wrap=True)
pline = PolyLine(Vertices=item, Closed=False)

bmap = BarrierMap(Environment=env)  # -> Mesh, Values
gradient = Gradient(LowerLimit=0, UpperLimit=1, Parameter=bmap.Values, stops=[0: RGB(0, 128, 0), 0.5: RGB(255, 255, 0), 1: RGB(255, 0, 0)])
explode = MeshExplode(Mesh=bmap.Mesh, Interpolate=False)
preview = CustomPreview(Geometry=explode, Shader=gradient)
